# Grasshopper definition DiTWP_UE_W25_12009639_GH-Modell.gh (Grasshopper 1.0.8)
# plug-ins: Speckle.Connector.Grasshopper, sof_gh_interface-2025

io = IO(
    SofistikDocumentProperties_Settings="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",
    SofistikDocumentProperties_VersionMajor="2025",
    SofistikDocumentProperties_VersionMinor="6")

mesh = Mesh(<mesh referenced from the Rhino model>)
mesh_2 = Mesh(<mesh referenced from the Rhino model>)
# Stützen
mesh_3 = Mesh(<mesh referenced from the Rhino model>)
deconstruct_mesh = DeconstructMesh(Mesh=mesh_3)  # -> Vertices, Faces, Colours, Normals
deconstruct_mesh_2 = DeconstructMesh(Mesh=mesh_2)  # -> Vertices, Faces, Colours, Normals
deconstruct_mesh_3 = DeconstructMesh(Mesh=mesh)  # -> Vertices, Faces, Colours, Normals

# ----
# Träger
mesh_4 = Mesh(<mesh referenced from the Rhino model>)
mesh_5 = Mesh(<mesh referenced from the Rhino model>)
deconstruct_mesh_4 = DeconstructMesh(Mesh=mesh_4)  # -> Vertices, Faces, Colours, Normals
deconstruct_mesh_5 = DeconstructMesh(Mesh=mesh_5)  # -> Vertices, Faces, Colours, Normals

# ----
# Bodenplatte
mesh_6 = Mesh(<mesh referenced from the Rhino model>)
deconstruct_mesh_6 = DeconstructMesh(Mesh=mesh_6)  # -> Vertices, Faces, Colours, Normals

cull_duplicates = CullDuplicates(Points=deconstruct_mesh_2.Vertices, Tolerance=0.1, CullMode=3)  # -> Points, Indices, Valence
cull_duplicates_2 = CullDuplicates(Points=deconstruct_mesh_3.Vertices, Tolerance=0.1, CullMode=3)  # -> Points, Indices, Valence
cull_duplicates_3 = CullDuplicates(Points=deconstruct_mesh.Vertices, Tolerance=0.1, CullMode=3)  # -> Points, Indices, Valence
cull_duplicates_4 = CullDuplicates(Points=deconstruct_mesh_4.Vertices, Tolerance=0.1, CullMode=3)  # -> Points, Indices, Valence
cull_duplicates_5 = CullDuplicates(Points=deconstruct_mesh_5.Vertices, Tolerance=0.1, CullMode=3)  # -> Points, Indices, Valence
fit_line = FitLine(Points=cull_duplicates.Points)
fit_line_2 = FitLine(Points=cull_duplicates_2.Points)
fit_line_3 = FitLine(Points=cull_duplicates_3.Points)
fit_line_4 = FitLine(Points=cull_duplicates_4.Points)
fit_line_5 = FitLine(Points=cull_duplicates_5.Points)

# ----
# Sofistik: Generieren von Punkten
control_points = ControlPoints(Curve=fit_line)  # -> Points, Weights, Knots
control_points_2 = ControlPoints(Curve=fit_line_4)  # -> Points, Weights, Knots
control_points_3 = ControlPoints(Curve=fit_line_5)  # -> Points, Weights, Knots
control_points_4 = ControlPoints(Curve=fit_line_3)  # -> Points, Weights, Knots
control_points_5 = ControlPoints(Curve=fit_line_2)  # -> Points, Weights, Knots
point = Point([control_points.Points, control_points_5.Points, control_points_4.Points, control_points_2.Points, control_points_3.Points])
cull_duplicates_6 = CullDuplicates(Points=point, Tolerance=0.1, CullMode=3)  # -> Points, Indices, Valence
list_length = ListLength(List=cull_duplicates_6.Points)
series = Series(Start="0", Step="1", Count=list_length)
panel = Panel("""F

F

F

PXPYPZ
PYPZ
PYPZ""")
text_tag = TextTag(Location=cull_duplicates_6.Points, Text=series, Colour=ColourSwatch(SwatchColor=RGB(255, 255, 255)))
structural_point = StructuralPoint(Point=cull_duplicates_6.Points, SptID=series, Fixation=panel)

# ----
# Sofistik: Strukturlinien generieren
# Träger
line = Line([fit_line_4, fit_line, fit_line_2, fit_line_3, fit_line_5])
panel_2 = Panel("""3
4""")
item = ListItem(List=line, Index=panel_2, Wrap=True)
panel_3 = Panel("""0
1
2""")
list_item = ListItem(List=line, Index=panel_3, Wrap=True)
line_2 = Line(item)
line_3 = Line(list_item)
list_length_2 = ListLength(List=line_2)
list_length_3 = ListLength(List=line_3)
# Stütze
panel_4 = Panel("101")
series_2 = Series(Start="201", Step="1", Count=list_length_2)
series_3 = Series(Start=panel_4, Step="1", Count=list_length_3)
structural_line = StructuralLine(Curve=line_2, SlnID=series_2, Group=0, Section="2", ElementType="From Section", FESize=0)
structural_line_2 = StructuralLine(Curve=line_3, SlnID=series_3, Group=0, Section="2", ElementType="From Section", FESize=0)

panel_5 = Panel(line)

# ----
# Rigid Link generieren
panel_6 = Panel("0")
list_item_2 = ListItem(List=structural_point, Index="6", Wrap=True)
list_item_3 = ListItem(List=structural_point, Index="8", Wrap=True)
list_item_4 = ListItem(List=structural_point, Index="2", Wrap=True)
list_item_5 = ListItem(List=structural_point, Index=panel_6, Wrap=True)
list_item_6 = ListItem(List=structural_point, Index="7", Wrap=True)
list_item_7 = ListItem(List=structural_point, Index="4", Wrap=True)
rigid_link = RigidLink(AGeometry=list_item_2, BGeometry=list_item_5, Group=0, Fixation="F")
rigid_link_2 = RigidLink(AGeometry=list_item_6, BGeometry=list_item_7, Group=0, Fixation="F")
rigid_link_3 = RigidLink(AGeometry=list_item_3, BGeometry=list_item_4, Group=0, Fixation="F")

# ----
# Matrikelnummer XYZ=639
# Eigenlast
# Nutzlast
# Schneelast
# Windlast
panel_7 = Panel("0.41")
addition = Addition(A=panel_7, B="4")
addition_2 = Addition(A="1.20", B="4")
multiplication = Multiplication(A="0.1", B="9")
unit_z = UnitZ(Factor=addition_2)
unit_y = UnitY(Factor=addition)
line_load = LineLoad(CurveSln=structural_line, Loadcase="1", Force=Vector(0, 0, 0), Moment=Vector(0, 0, 0), HostLocal=False)
addition_3 = Addition(A="5", B=multiplication)
negative = Negative(Value=unit_z)
negative_2 = Negative(Value=unit_y)
unit_z_2 = UnitZ(Factor=addition_3)
line_load_2 = LineLoad(CurveSln=structural_line_2, Loadcase="31", Force=unit_y, Moment=Vector(0, 0, 0), HostLocal=False)
line_load_3 = LineLoad(CurveSln=structural_line_2, Loadcase="30", Force=negative_2, Moment=Vector(0, 0, 0), HostLocal=False)
line_load_4 = LineLoad(CurveSln=structural_line, Loadcase="20", Force=negative, Moment=Vector(0, 0, 0), HostLocal=False)
negative_3 = Negative(Value=unit_z_2)
line_load_5 = LineLoad(CurveSln=structural_line, Loadcase="10", Force=negative_3, Moment=Vector(0, 0, 0), HostLocal=False)
panel_8 = Panel("""G
Q
S
W
W""")
panel_9 = Panel("""Eigenlast
Nutzlast
Schneelast
Windlast
Windlast rev""")
panel_10 = Panel("""1
0
0
0
0""")
loadcase_attributes = LoadcaseAttributes(Loadcase=["1", "10", "20", "30", "31"], Action=panel_8, FacDeadload=panel_10, Title=panel_9)
data = Data([line_load, line_load_5, line_load_4, line_load_3, line_load_2], AlwaysInheritNames=False, CanInheritNames=True)
sofiload = SOFiLOAD(Loads=data, LCAttributes=loadcase_attributes)  # -> TextInput, Log
panel_11 = Panel(sofiload.TextInput)
panel_12 = Panel("C:\Users\leago\FH MABAU26\3. Semester\Digitale Tragwerksplanung\Übung\Sofiload.dat")
text_file = TextFile(TextInput=sofiload.TextInput, FilePath=panel_12, SOF_STREAM_CONTENT=True)

# ----
# Schnittgrößenermittlung
panel_13 = Panel("Berechnung")
panel_14 = Panel(["31", "30", "20", "10", "1"])
ase = ASE(Loadcase=panel_14, Threads=-1, Header=panel_13)  # -> TextInput, Log
panel_15 = Panel(ase.TextInput)
panel_16 = Panel("C:\Users\leago\FH MABAU26\3. Semester\Digitale Tragwerksplanung\Übung\ASE.dat")
text_file_2 = TextFile(TextInput=ase.TextInput, FilePath=panel_16, SOF_STREAM_CONTENT=True)

# ----
# Sofistikeingabe
data_2 = Data([rigid_link_2, rigid_link_3, rigid_link, structural_line, structural_line_2])
sofimshc = SOFiMSHC(
    StructuralElements=data_2,
    InitSystem=True,
    MeshSize=0,
    StartIndex=1000,
    GroupDivisor=-1000,
    Interpolate=True,
    Header="Model")  # -> TextInput, Log
panel_17 = Panel(sofimshc.TextInput)
panel_18 = Panel("C:\Users\leago\FH MABAU26\3. Semester\Digitale Tragwerksplanung\Übung\Sofimshc.dat")
text_file_3 = TextFile(TextInput=sofimshc.TextInput, FilePath=panel_18, SOF_STREAM_CONTENT=True)
